# Grasshopper definition regen_changing_coast.gh (Grasshopper 1.0.7)

path = FilePath("D:\Github\CoastSat\data\offsets copy.csv")
cir = Circle(Plane=PlaneXY(0, 0, 0), Radius="1500")
file = ReadFile(File=path, PerLineParse=True)
split = SplitList(List=file, Index=1)  # -> ListA, ListB
panel = Panel(split.ListA)
rep = ReplaceText(Text=split.ListB, Find=",", RecursiveReplace=False)
len = TextLength(Text=rep)
smaller = SmallerThan(FirstNumber=len, SecondNumber="12")  # -> SmallerThan, OrEqualTo
cull = CullPattern(List=split.ListB, CullPattern=invert(smaller.SmallerThan))
lng = ListLength(List=split.ListB)
split_2 = TextSplit(Text=cull, Separators=",")  # -> simplify(Result)
range = Range(Domain=Domain(0, 1), Steps=expr("x-1", lng))
range_2 = Range(Domain=Domain(0, 1), Steps=expr("x-1", "100"))
split_3 = SplitList(List=split_2, Index="1")  # -> ListA, ListB
graph = GraphMapper(
    range,
    x0=0,
    x1=1,
    y0=-1,
    y1=1,
    container_name="Sine Summation",
    Equation0_px=[0.1955802292, 0.3],
    Equation0_py=[0.08140295744, 0.3],
    Equation1_px=[0.6, 0.9140871763],
    Equation1_py=[0.3, 0.5835343599])
graph_2 = GraphMapper(
    range_2,
    x0=0,
    x1=1,
    y0=0,
    y1=1,
    amplitude=0.4642924666,
    container_name="Perlin",
    decay=0.004807174206,
    frequency=0.06683892012,
    x_offset=0.5,
    y_offset=0.5)
viewer = ParamViewer(split_3.ListB)
branch = TreeBranch(Tree=split_3.ListB, Path=viewer, MaintainPaths=True)
cluster = Cluster_3(num=branch, A=Slider(1, range=0..1))
cluster_2 = Cluster_2(num=cluster)
multiplication = Multiplication(A=graft(graph), B=graph_2)  # -> simplify(Result)
c_script = CSharpScript(start_curve=cir, offsets=cluster_2)  # -> out, crv_out, offset_tracks, last_crv, prev_crvs, planes, pts_out; inputs start_curve: Curve, offsets: tree of Double
# ---------- c_script: C# ----------
    Rhino.Geometry.Curve w_crv = start_curve;

    List<Rhino.Geometry.Line> tracks = new List<Rhino.Geometry.Line>();
    List<Rhino.Geometry.Curve> crv_seq = new List<Rhino.Geometry.Curve>();

    for(int i = 0; i < offsets.BranchCount ; i++){
      List<double> offset_step = offsets.Branch(i);
      int cnt = offset_step.Count;
      var t_vals = w_crv.DivideByCount(cnt, true);
      crv_seq.Add(w_crv);
      Rhino.Geometry.Plane[] plns = w_crv.GetPerpendicularFrames(t_vals);
      planes = plns;
      int pt_cnt = 0;
      List<Rhino.Geometry.Point3d> pts = new List<Rhino.Geometry.Point3d>();

      foreach(var t_val in t_vals){
        var pt = plns[pt_cnt].PointAt(-offset_step[pt_cnt], 0);
        pts.Add(pt);
        tracks.Add(new Rhino.Geometry.Line(plns[pt_cnt].Origin, pt));

        pt_cnt++;
      }
      pts_out = pts;
      w_crv = Rhino.Geometry.Curve.CreatePeriodicCurve(Rhino.Geometry.Curve.CreateInterpolatedCurve(pts, 3));
    }
    prev_crvs = crv_seq;
    offset_tracks = tracks;
    crv_out = w_crv;
# ---------- end c_script ----------
crv = Curve(cir)
multiplication_2 = Multiplication(A=multiplication, B="5")  # -> simplify(Result)
lng_2 = ListLength(List=c_script.prev_crvs)  # -> expr("x-1", Length)
pt = Point(c_script.pts_out)
range_3 = Range(Domain=Domain(0, 1), Steps=lng_2)
gradient = Gradient(LowerLimit=0, UpperLimit=1, Parameter=range_3, stops=[0.0572: RGB(192, 255, 255), 0.948: RGB(0, 0, 128)])
crv_2 = Curve(c_script.crv_out)
preview = CustomPreview(Geometry=crv, Material=ColourSwatch(SwatchColor=RGB(199, 242, 239)))
preview_2 = CustomPreview(Geometry=c_script.offset_tracks, Material=ColourSwatch(SwatchColor=RGB(150, 204, 124)))
preview_3 = CustomPreview(Geometry=c_script.prev_crvs, Material=gradient)
preview_4 = CustomPreview(Geometry=crv_2, Material=ColourSwatch(SwatchColor=RGB(0, 37, 122)))

# ==== cluster Cluster_2
num = ClusterInput()
num_2 = Number(simplify(num))
len = TextLength(Text=num_2)
smaller = SmallerThan(FirstNumber=len, SecondNumber="1")  # -> SmallerThan, OrEqualTo
concat = Concatenate(FragmentA=num_2, FragmentB="0")
p_n_c = PickNChoose(Pattern=smaller.SmallerThan, Stream0=num_2, Stream1=concat)  # -> simplify(Result)
num_3 = Number(p_n_c)
cluster = Cluster(num=num_3)
num_4 = ClusterOutput(cluster)

# ==== cluster Cluster_3
A = ClusterInput()
num = ClusterInput()
num_2 = Number(simplify(num))
viewer = ParamViewer(num_2)
lng = ListLength(List=viewer)
multiplication = Multiplication(A=A, B=lng)
int = Integer(multiplication)
split = SplitList(List=viewer, Index=int)  # -> ListA, ListB
branch = TreeBranch(Tree=num_2, Path=split.ListA, MaintainPaths=True)
B = ClusterOutput(branch)

# ==== cluster Cluster
num = ClusterInput()
num_2 = Number(num)
ma = MassAddition(Input=num_2)  # -> Result, PartialResults
viewer = ParamViewer(num_2)
bool = Boolean(ma.Result)
dispatch = Dispatch(List=viewer, DispatchPattern=flatten(bool))  # -> ListA, ListB
branch = TreeBranch(Tree=num_2, Path=dispatch.ListA, MaintainPaths=True)
branch_2 = TreeBranch(Tree=num_2, Path=dispatch.ListB, MaintainPaths=True)
num_3 = Number(branch)
abs = Absolute(Value=num_3)
division = Division(A=num_3, B=abs)
avr = Average(Input=abs)
division_2 = Division(A=abs, B=avr)
multiplication = Multiplication(A=avr, B=division)
larger = LargerThan(FirstNumber=division_2, SecondNumber="10")  # -> LargerThan, OrEqualTo
p_n_c = PickNChoose(Pattern=larger.LargerThan, Stream0=num_3, Stream1=multiplication)
merge = Merge(Data1=p_n_c, Data2=branch_2)
num_4 = Number(merge)
num_5 = ClusterOutput(num_4)
