# Grasshopper definition regen_changing_coast_2.gh (Grasshopper 1.0.7)

path = FilePath("D:\Github\CoastSat\data\offsets copy.csv")
file = ReadFile(File=path, PerLineParse=True)
path_2 = FilePath("D:\Github\CoastSat\data\initial_coast.csv")
split = SplitList(List=file, Index=1)  # -> ListA, ListB
file_2 = ReadFile(File=path_2, PerLineParse=True)
rep = ReplaceText(Text=split.ListB, Find=",", RecursiveReplace=False)
panel = Panel(split.ListA)
split_2 = SplitList(List=file_2, Index=1)  # -> ListA, ListB
expression = Expression(x=split_2.ListB, Expression="Format(\"{0:0.000000000}\", x)")
len = TextLength(Text=rep)
smaller = SmallerThan(FirstNumber=len, SecondNumber="12")  # -> SmallerThan, OrEqualTo
cull = CullPattern(List=split.ListB, CullPattern=invert(smaller.SmallerThan))
panel_2 = Panel(split_2.ListA)
lng = ListLength(List=split.ListB)
split_3 = TextSplit(Text=cull, Separators=",")  # -> simplify(Result)
split_4 = TextSplit(Text=expression, Separators=",")  # -> simplify(Result)
range = Range(Domain=Domain(0, 1), Steps=expr("x-1", lng))
range_2 = Range(Domain=Domain(0, 1), Steps=expr("x-1", "100"))
split_5 = SplitList(List=split_3, Index="1")  # -> ListA, ListB
item = ListItem(List=split_4, Index=0, Wrap=True)  # -> Item, Item1
graph = GraphMapper(
    range,
    x0=0,
    x1=1,
    y0=-1,
    y1=1,
    container_name="Sine Summation",
    Equation0_px=[0.1955802292, 0.3],
    Equation0_py=[0.08140295744, 0.3],
    Equation1_px=[0.6, 0.9140871763],
    Equation1_py=[0.3, 0.5835343599])
graph_2 = GraphMapper(
    range_2,
    x0=0,
    x1=1,
    y0=0,
    y1=1,
    amplitude=0.4642924666,
    container_name="Perlin",
    decay=0.004807174206,
    frequency=0.06683892012,
    x_offset=0.5,
    y_offset=0.5)
viewer = ParamViewer(split_5.ListB)
multiplication = Multiplication(A=item.Item1, B="100000")
multiplication_2 = Multiplication(A=item.Item, B="100000")
branch = TreeBranch(Tree=split_5.ListB, Path=viewer, MaintainPaths=True)
cluster = Cluster_3(num=branch, A=Slider(1, range=0..1))
pt = ConstructPoint(XCoordinate=multiplication_2, YCoordinate=multiplication, ZCoordinate=0)  # -> flatten(Point)
cluster_2 = Cluster_2(num=cluster)
intcrv = Interpolate(Vertices=pt, Degree=3, Periodic=True, KnotStyle=1)  # -> Curve, Length, Domain
multiplication_3 = Multiplication(A=graft(graph), B=graph_2)  # -> simplify(Result)
multiplication_4 = Multiplication(A=multiplication_3, B="5")  # -> simplify(Result)
multiplication_5 = Multiplication(A=cluster_2, B="100000")
c_script = CSharpScript(start_curve=intcrv.Curve, offsets=multiplication_5)  # -> out, crv_out, offset_tracks, last_crv, prev_crvs, planes, pts_out; inputs start_curve: Curve, offsets: tree of Double
# ---------- c_script: C# ----------
    Rhino.Geometry.Curve w_crv = start_curve;

    List<Rhino.Geometry.Line> tracks = new List<Rhino.Geometry.Line>();
    List<Rhino.Geometry.Curve> crv_seq = new List<Rhino.Geometry.Curve>();

    for(int i = 0; i < offsets.BranchCount ; i++){
      List<double> offset_step = offsets.Branch(i);
      int cnt = offset_step.Count;
      var t_vals = w_crv.DivideByCount(cnt, true);
      crv_seq.Add(w_crv);
      Rhino.Geometry.Plane[] plns = w_crv.GetPerpendicularFrames(t_vals);
      planes = plns;
      int pt_cnt = 0;
      List<Rhino.Geometry.Point3d> pts = new List<Rhino.Geometry.Point3d>();

      foreach(var t_val in t_vals){
        var pt = plns[pt_cnt].PointAt(-offset_step[pt_cnt], 0);
        pts.Add(pt);
        tracks.Add(new Rhino.Geometry.Line(plns[pt_cnt].Origin, pt));

        pt_cnt++;
      }
      pts_out = pts;
      w_crv = Rhino.Geometry.Curve.CreatePeriodicCurve(Rhino.Geometry.Curve.CreateInterpolatedCurve(pts, 3));
    }
    prev_crvs = crv_seq;
    offset_tracks = tracks;
    crv_out = w_crv;
# ---------- end c_script ----------
crv = Curve(intcrv.Curve)
lng_2 = ListLength(List=c_script.prev_crvs)  # -> expr("x-1", Length)
pt_2 = Point(c_script.pts_out)
range_3 = Range(Domain=Domain(0, 1), Steps=lng_2)
gradient = Gradient(LowerLimit=0, UpperLimit=1, Parameter=range_3, stops=[0.0572: RGB(192, 255, 255), 0.948: RGB(0, 0, 128)])
crv_2 = Curve(c_script.crv_out)
preview = CustomPreview(Geometry=crv, Material=ColourSwatch(SwatchColor=RGB(199, 242, 239)))
preview_2 = CustomPreview(Geometry=c_script.offset_tracks, Material=ColourSwatch(SwatchColor=RGB(150, 204, 124)))
preview_3 = CustomPreview(Geometry=c_script.prev_crvs, Material=gradient)
preview_4 = CustomPreview(Geometry=crv_2, Material=ColourSwatch(SwatchColor=RGB(0, 37, 122)))

# ==== cluster Cluster_2
num = ClusterInput()
num_2 = Number(simplify(num))
len = TextLength(Text=num_2)
smaller = SmallerThan(FirstNumber=len, SecondNumber="1")  # -> SmallerThan, OrEqualTo
concat = Concatenate(FragmentA=num_2, FragmentB="0")
p_n_c = PickNChoose(Pattern=smaller.SmallerThan, Stream0=num_2, Stream1=concat)  # -> simplify(Result)
num_3 = Number(p_n_c)
cluster = Cluster(num=num_3)
num_4 = ClusterOutput(cluster)

# ==== cluster Cluster_3
num = ClusterInput()
num_2 = Number(simplify(num))
viewer = ParamViewer(num_2)
A = ClusterInput()
lng = ListLength(List=viewer)
multiplication = Multiplication(A=A, B=lng)
int = Integer(multiplication)
split = SplitList(List=viewer, Index=int)  # -> ListA, ListB
branch = TreeBranch(Tree=num_2, Path=split.ListA, MaintainPaths=True)
B = ClusterOutput(branch)

# ==== cluster Cluster
num = ClusterInput()
num_2 = Number(num)
ma = MassAddition(Input=num_2)  # -> Result, PartialResults
viewer = ParamViewer(num_2)
bool = Boolean(ma.Result)
dispatch = Dispatch(List=viewer, DispatchPattern=flatten(bool))  # -> ListA, ListB
branch = TreeBranch(Tree=num_2, Path=dispatch.ListA, MaintainPaths=True)
branch_2 = TreeBranch(Tree=num_2, Path=dispatch.ListB, MaintainPaths=True)
num_3 = Number(branch)
abs = Absolute(Value=num_3)
division = Division(A=num_3, B=abs)
avr = Average(Input=abs)
division_2 = Division(A=abs, B=avr)
multiplication = Multiplication(A=avr, B=division)
larger = LargerThan(FirstNumber=division_2, SecondNumber="10")  # -> LargerThan, OrEqualTo
p_n_c = PickNChoose(Pattern=larger.LargerThan, Stream0=num_3, Stream1=multiplication)
merge = Merge(Data1=p_n_c, Data2=branch_2)
num_4 = Number(merge)
num_5 = ClusterOutput(num_4)
